# Grasshopper definition first.gh (Grasshopper 1.0.8)

len = Slider(27, range=0..30)
len_2 = Slider(18, range=0..20)
pt = ConstructPoint(XCoordinate=0, YCoordinate=0, ZCoordinate=0)
vec = VectorXYZ(XComponent=len_2, YComponent=len, ZComponent=0)  # -> Vector, Length
pt_2 = Point(pt)
offset = Slider(1.341, range=0..9)
move = Move(Geometry=pt_2, Motion=vec.Vector)  # -> Geometry, Transform
rec_2pt = Rectangle2Pt(Plane=PlaneXY(0, 0, 0), PointA=pt_2, PointB=move.Geometry, Radius=0)  # -> Rectangle, Length
neg = Negative(Value=offset)
offset_2 = OffsetCurve(Curve=rec_2pt.Rectangle, Distance=neg, Corners=1)
